# Grasshopper definition Museum.gh (Grasshopper 1.0.7)

veronu = VerONU()

# ==== cluster VerONU: Open aNd use

knob = ControlKnob(Decimals=0, Limit=True, Maximum=99, Minimum=0, Range=10, Value=0)
list = ValueList({"ALPHA": "ALPHA.a.", "Beta": "Beta.0.", "Stable": " "}, selected="ALPHA")
ver = VersionCreate(P="项目名称", D=[list, Slider(1, range=1..9)], V=Slider(0, range=0..9), D_2=knob)
panel = Panel(ver)

# ==== cluster VersionCreate: 自动更新
D = ClusterInput()  # type
bang = ExplodeTree(Data=graft(D))  # -> Branch0, Branch1
T = Text(bang.Branch0)
entwine = Entwine(Branch00=bang.Branch1, Branch01=".", FlattenInputs=True)  # -> flatten(Result)
tmatch = MatchText(Text=T, Pattern=" ", Case=True)
join = TextJoin(Text=entwine)
P = ClusterInput()
p_n_c = PickNChoose(Pattern=tmatch, Stream0=T, Stream1=join)
D_2 = ClusterInput()
V = ClusterInput()
P_2 = Text(P)
V_2 = Integer(V)
D_3 = Integer(D_2)
entwine_2 = Entwine(Branch00=P_2, Branch02="Ver-", Branch03=p_n_c, Branch04=V_2, Branch05=".", Branch06=D_3, FlattenInputs=True)  # -> flatten(Result)
join_2 = TextJoin(Text=entwine_2)
R = ClusterOutput(join_2)
